# Grasshopper definition AUV_AUVR_100.gh (Grasshopper 1.0.8)

# ----
# 2) ASSIGN UNCERTAINTY BY APPLYING
# MATERIALS TO THE OBJECTS IN RHINO
# (Name them from 1 to 7)
# 
# Click the buttons to select by Uncerainty:
_1 = Button()
_5 = Button()
_2 = Button()
_6 = Button()
_3 = Button()
_7 = Button()
_4 = Button()
no_uncertainty = Button()

# ----
# 1) LOAD GEOMETRY HERE
# (right click and set multiple geometries)
upload_all_geometry_here = Geometry()
get_geometry_for_grasshopper_player = GetGeometry(
    upload_all_geometry_here,
    AnnotationTypeFilter=0,
    AtLeast=1,
    AtMost=100000,
    DeleteInput=False,
    Filter=1073741880,
    TreeAccess=False)

# ----
# 3) ASSIGN RELEVANCE THROUGH THE
# ATTRIBUTE USER TEXT TAB IN RHINO
# (create a key called  "relevance" and assign
# a numerical value, if no attribute is assigned
# 1 will be used by default)
# 
# Click the buttons to select by Relevance:
relevance_1 = Button()
relevance_1_2 = Button()
relevance_1_3 = Button()

level_of_uncertainty = Slider(1, range=1..8)
level_of_uncertainty_2 = Slider(2, range=1..8)
level_of_uncertainty_3 = Slider(3, range=1..8)
level_of_uncertainty_4 = Slider(5, range=1..8)
level_of_uncertainty_5 = Slider(6, range=1..8)
level_of_uncertainty_6 = Slider(7, range=1..8)
level_of_uncertainty_7 = Slider(4, range=1..8)
uncertainty = Panel("21.428")
uncertainty_2 = Panel("92.857")
uncertainty_3 = Panel("35.714")
uncertainty_4 = Panel("78.571")
uncertainty_5 = Panel("50.0")
uncertainty_6 = Panel("7.1425")
uncertainty_7 = Panel("64.2855")

# ---- group: create an empty list for storing uncertainty
# CREATE A LIST OF UNCERTAINTY BASED ON
# RHINO MATERIALS (named from 1 to 7)
all_geometry = Data(get_geometry_for_grasshopper_player)
lng = ListLength(List=all_geometry)
dup = DuplicateData(Number=lng, Order=True)

# ---- group: apply relevance and uncertainty
all_geometry_2 = Data(get_geometry_for_grasshopper_player)
id = Guid(all_geometry_2)
py3 = Python3Script(objs=id, mat_name=level_of_uncertainty)  # -> out, has_material; inputs objs: list, mat_name: String
# ---------- py3: Python ----------
"""
Inputs:
    objs: list of Guids or Breps (Rhino referenced objects or GH Breps)
    mat_name: str (material name to check)
Outputs:
    has_material: list of booleans
"""

import Rhino
import scriptcontext as sc
import System

has_material = []

if objs and mat_name:
    old_doc = sc.doc
    sc.doc = Rhino.RhinoDoc.ActiveDoc
    try:
        for obj in objs:
            found = False

            # Case 1: input is a Rhino object Guid
            if isinstance(obj, System.Guid):
                rh_obj = sc.doc.Objects.Find(obj)
                if rh_obj:
                    idx = rh_obj.Attributes.MaterialIndex
                    if idx >= 0:
                        mat = sc.doc.Materials[idx]
                        if mat and mat.Name == mat_name:
                            found = True

            # Case 2: input is geometry (GH Brep, etc.) → no material info
            else:
                found = "INPUT GUIDS ONLY NOT BREPS"

            has_material.append(found)
    finally:
        sc.doc = old_doc
else:
    has_material = []
# ---------- end py3 ----------
cull = CullPattern(List=all_geometry_2, CullPattern=py3.has_material)
panel = Panel(py3.has_material)
mindex = MemberIndex(Set=panel, Member="True")  # -> Index, Count
replace = ReplaceItems(List=dup, Item=uncertainty_6, Indices=mindex.Index, Wrap=False)

# ----
# Read RELEVANCE from
# rhino objects attribute user text
panel_2 = Panel("relevance")
all_geometry_3 = Data(get_geometry_for_grasshopper_player)
user_text = UserText(Content=all_geometry_3, Keys=panel_2, UserTextMode=1)  # -> Content, Keys, flatten(Values)
null = NullItem(Item=user_text.Values)  # -> NullFlags, InvalidFlags, Description
panel_3 = Panel(null.NullFlags)
mindex_2 = MemberIndex(Set=panel_3, Member="True")  # -> Index, Count
replace_2 = ReplaceItems(List=user_text.Values, Item="1", Indices=mindex_2.Index, Wrap=False)

# ---- group: apply relevance and uncertainty
all_geometry_4 = Data(get_geometry_for_grasshopper_player)
id_2 = Guid(all_geometry_4)
py3_2 = Python3Script(objs=id_2, mat_name=level_of_uncertainty_2)  # -> out, has_material; inputs objs: list, mat_name: String; same code as py3
cull_2 = CullPattern(List=all_geometry_4, CullPattern=py3_2.has_material)
panel_4 = Panel(py3_2.has_material)
mindex_3 = MemberIndex(Set=panel_4, Member="True")  # -> Index, Count
replace_3 = ReplaceItems(List=replace, Item=uncertainty, Indices=mindex_3.Index, Wrap=False)

all_geometry_5 = Data(get_geometry_for_grasshopper_player)
id_3 = Guid(all_geometry_5)
py3_3 = Python3Script(objs=id_3, mat_name=level_of_uncertainty_3)  # -> out, has_material; inputs objs: list, mat_name: String; same code as py3
cull_3 = CullPattern(List=all_geometry_5, CullPattern=py3_3.has_material)
panel_5 = Panel(py3_3.has_material)
mindex_4 = MemberIndex(Set=panel_5, Member="True")  # -> Index, Count
replace_4 = ReplaceItems(List=replace_3, Item=uncertainty_3, Indices=mindex_4.Index, Wrap=False)

all_geometry_6 = Data(get_geometry_for_grasshopper_player)
id_4 = Guid(all_geometry_6)
py3_4 = Python3Script(objs=id_4, mat_name=level_of_uncertainty_7)  # -> out, has_material; inputs objs: list, mat_name: String; same code as py3
cull_4 = CullPattern(List=all_geometry_6, CullPattern=py3_4.has_material)
panel_6 = Panel(py3_4.has_material)
mindex_5 = MemberIndex(Set=panel_6, Member="True")  # -> Index, Count
replace_5 = ReplaceItems(List=replace_4, Item=uncertainty_5, Indices=mindex_5.Index, Wrap=False)

all_geometry_7 = Data(get_geometry_for_grasshopper_player)
id_5 = Guid(all_geometry_7)
py3_5 = Python3Script(objs=id_5, mat_name=level_of_uncertainty_4)  # -> out, has_material; inputs objs: list, mat_name: String; same code as py3
cull_5 = CullPattern(List=all_geometry_7, CullPattern=py3_5.has_material)
panel_7 = Panel(py3_5.has_material)
mindex_6 = MemberIndex(Set=panel_7, Member="True")  # -> Index, Count
replace_6 = ReplaceItems(List=replace_5, Item=uncertainty_7, Indices=mindex_6.Index, Wrap=False)

all_geometry_8 = Data(get_geometry_for_grasshopper_player)
id_6 = Guid(all_geometry_8)
py3_6 = Python3Script(objs=id_6, mat_name=level_of_uncertainty_5)  # -> out, has_material; inputs objs: list, mat_name: String; same code as py3
cull_6 = CullPattern(List=all_geometry_8, CullPattern=py3_6.has_material)
panel_8 = Panel(py3_6.has_material)
mindex_7 = MemberIndex(Set=panel_8, Member="True")  # -> Index, Count
replace_7 = ReplaceItems(List=replace_6, Item=uncertainty_4, Indices=mindex_7.Index, Wrap=False)

all_geometry_9 = Data(get_geometry_for_grasshopper_player)
id_7 = Guid(all_geometry_9)
py3_7 = Python3Script(objs=id_7, mat_name=level_of_uncertainty_6)  # -> out, has_material; inputs objs: list, mat_name: String; same code as py3
cull_7 = CullPattern(List=all_geometry_9, CullPattern=py3_7.has_material)
panel_9 = Panel(py3_7.has_material)
mindex_8 = MemberIndex(Set=panel_9, Member="True")  # -> Index, Count
replace_8 = ReplaceItems(List=replace_7, Item=uncertainty_2, Indices=mindex_8.Index, Wrap=False)

# ----
# Calcualte VOLUME
# (only input verified closed
# geometry to avoid crashes)
volume = Volume(Geometry=all_geometry)  # -> Volume, Centroid

# ---- group: cull pattern for objects with no uncertainty assigned
expression = Expression(y=replace_8, Expression="x=y")

# ----
# Select by uncertainty
# Level 1
all_geometry_10 = Data(get_geometry_for_grasshopper_player)
cull_pattern_lvl1 = Data(py3.has_material)
boolean_button = Data(_1)
id_8 = Guid(all_geometry_10)
cull_8 = CullPattern(List=id_8, CullPattern=cull_pattern_lvl1)
py3_8 = Python3Script(x=cull_8, y=boolean_button)  # -> out, a; inputs x: list of String, y: Boolean
# ---------- py3_8: Python ----------
import Rhino
import scriptcontext as sc
import System

# Assicurati di operare sul documento attivo
sc.doc = Rhino.RhinoDoc.ActiveDoc

def select_objects_by_id(object_ids):
    # Deseleziona tutti gli oggetti nel documento
    deselect_all_objects()
    
    # Lista per tenere traccia degli oggetti trovati e selezionati
    selected_ids = []
    
    print("Selection activated.")
    # Itera su ciascun ID
    for obj_id in object_ids:
        try:
            # Converte la stringa in GUID
            guid = System.Guid(obj_id)
            
            # Trova l'oggetto in base al GUID
            obj = sc.doc.Objects.Find(guid)
            
            if obj:
                # Seleziona l'oggetto
                obj.Select(True)
                selected_ids.append(obj_id)
                print(f"Selected object ID: {obj_id}")
            else:
                print(f"Object ID {obj_id} not found in the document.")
        except Exception as e:
            print(f"Error with ID {obj_id}: {e}")
    
    # Aggiorna la vista per riflettere le selezioni
    sc.doc.Views.Redraw()
    
    return selected_ids

def deselect_all_objects():
    # Utilizza RhinoCommon per deselezionare tutti gli oggetti
    for obj in sc.doc.Objects:
        if obj.IsSelected(False) > 0:
            obj.Select(False)

# Inputs
object_ids = x  # Assumendo che x sia già una lista di ID
button_pressed = y  # Booleano generato dal pulsante

# Verifica che il documento attivo sia corretto
print("Active Document:", sc.doc)

# Se il pulsante è premuto, esegui la selezione
selected_objects = []
if button_pressed:
    selected_objects = select_objects_by_id(object_ids)

# Output
a = selected_objects
# ---------- end py3_8 ----------

# ----
# Select by uncertainty
# Level 5
all_geometry_11 = Data(get_geometry_for_grasshopper_player)
cull_pattern_lvl5 = Data(py3_5.has_material)
boolean_button_2 = Data(_5)
id_9 = Guid(all_geometry_11)
cull_9 = CullPattern(List=id_9, CullPattern=cull_pattern_lvl5)
py3_9 = Python3Script(x=cull_9, y=boolean_button_2)  # -> out, a; inputs x: list of String, y: Boolean; same code as py3_8

# ----
# Select by uncertainty
# Level 2
all_geometry_12 = Data(get_geometry_for_grasshopper_player)
cull_pattern_lvl2 = Data(py3_2.has_material)
boolean_button_3 = Data(_2)
id_10 = Guid(all_geometry_12)
cull_10 = CullPattern(List=id_10, CullPattern=cull_pattern_lvl2)
py3_10 = Python3Script(x=cull_10, y=boolean_button_3)  # -> out, a; inputs x: list of String, y: Boolean; same code as py3_8

# ----
# Select by uncertainty
# Level 6
all_geometry_13 = Data(get_geometry_for_grasshopper_player)
cull_pattern_lvl6 = Data(py3_6.has_material)
boolean_button_4 = Data(_6)
id_11 = Guid(all_geometry_13)
cull_11 = CullPattern(List=id_11, CullPattern=cull_pattern_lvl6)
py3_11 = Python3Script(x=cull_11, y=boolean_button_4)  # -> out, a; inputs x: list of String, y: Boolean; same code as py3_8

# ----
# Select by uncertainty
# Level 3
all_geometry_14 = Data(get_geometry_for_grasshopper_player)
cull_pattern_lvl3 = Data(py3_3.has_material)
boolean_button_5 = Data(_3)
id_12 = Guid(all_geometry_14)
cull_12 = CullPattern(List=id_12, CullPattern=cull_pattern_lvl3)
py3_12 = Python3Script(x=cull_12, y=boolean_button_5)  # -> out, a; inputs x: list of String, y: Boolean; same code as py3_8

# ----
# Select by uncertainty
# Level 4
all_geometry_15 = Data(get_geometry_for_grasshopper_player)
cull_pattern_lvl4 = Data(py3_4.has_material)
boolean_button_6 = Data(_4)
id_13 = Guid(all_geometry_15)
cull_13 = CullPattern(List=id_13, CullPattern=cull_pattern_lvl4)
py3_13 = Python3Script(x=cull_13, y=boolean_button_6)  # -> out, a; inputs x: list of String, y: Boolean; same code as py3_8

# ----
# Select by uncertainty
# Level 7
all_geometry_16 = Data(get_geometry_for_grasshopper_player)
cull_pattern_lvl7 = Data(py3_7.has_material)
boolean_button_7 = Data(_7)
id_14 = Guid(all_geometry_16)
cull_14 = CullPattern(List=id_14, CullPattern=cull_pattern_lvl7)
py3_14 = Python3Script(x=cull_14, y=boolean_button_7)  # -> out, a; inputs x: list of String, y: Boolean; same code as py3_8

# ----
# Select by uncertainty
# Level 7
all_geometry_17 = Data(get_geometry_for_grasshopper_player)
cull_pattern_no_uncertainty = Data(expression)
boolean_button_8 = Data(no_uncertainty)
id_15 = Guid(all_geometry_17)
cull_15 = CullPattern(List=id_15, CullPattern=cull_pattern_no_uncertainty)
py3_15 = Python3Script(x=cull_15, y=boolean_button_8)  # -> out, a; inputs x: list of String, y: Boolean; same code as py3_8

larger = LargerThan(FirstNumber=replace_2, SecondNumber="1")  # -> LargerThan, OrEqualTo

equals = Equality(FirstNumber=replace_2, SecondNumber="1")  # -> Equality, Inequality

smaller = SmallerThan(FirstNumber=replace_2, SecondNumber="1")  # -> SmallerThan, OrEqualTo

# ----
# SELECT BY RELEVANCE
# Relevance larger than 1
all_geometry_18 = Data(get_geometry_for_grasshopper_player)
boolean_button_9 = Data(relevance_1_3)
id_16 = Guid(all_geometry_18)
cull_16 = CullPattern(List=id_16, CullPattern=larger.LargerThan)
py3_16 = Python3Script(x=cull_16, y=boolean_button_9)  # -> out, a; inputs x: list of String, y: Boolean; same code as py3_8

# ----
# Relevance smaller than 1
all_geometry_19 = Data(get_geometry_for_grasshopper_player)
boolean_button_10 = Data(relevance_1_2)
id_17 = Guid(all_geometry_19)
cull_17 = CullPattern(List=id_17, CullPattern=equals.Equality)
py3_17 = Python3Script(x=cull_17, y=boolean_button_10)  # -> out, a; inputs x: list of String, y: Boolean; same code as py3_8

# ----
# Relevance smaller than 1
all_geometry_20 = Data(get_geometry_for_grasshopper_player)
boolean_button_11 = Data(relevance_1)
id_18 = Guid(all_geometry_20)
cull_18 = CullPattern(List=id_18, CullPattern=smaller.SmallerThan)
py3_18 = Python3Script(x=cull_18, y=boolean_button_11)  # -> out, a; inputs x: list of String, y: Boolean; same code as py3_8

# ---- group: remove objects with no unceratity assigned
cull_pattern_for_objects_with_no_uncerta = Data(expression)  # "cull pattern for objects with no uncertainty assigned"
cull_19 = CullPattern(List=volume.Volume, CullPattern=invert(cull_pattern_for_objects_with_no_uncerta))

cull_pattern_for_objects_with_no_uncerta_2 = Data(expression)  # "cull pattern for objects with no uncertainty assigned"
cull_20 = CullPattern(List=replace_2, CullPattern=invert(cull_pattern_for_objects_with_no_uncerta_2))

cull_pattern_for_objects_with_no_uncerta_3 = Data(expression)  # "cull pattern for objects with no uncertainty assigned"
cull_21 = CullPattern(List=replace_8, CullPattern=invert(cull_pattern_for_objects_with_no_uncerta_3))

# ---- group: Vol x Uncert
sorted_list_of_uncertaintites = Data(cull_21)
sorted_list_of_volumes = Data(cull_19)
multiplication = Multiplication(A=sorted_list_of_volumes, B=sorted_list_of_uncertaintites)

# ---- group: Vol x Uncert x Relev
sorted_list_of_uncertaintites_2 = Data(cull_21)
sorted_list_of_relevances = Data(cull_20)
sorted_list_of_volumes_2 = Data(cull_19)
multiplication_2 = Multiplication(A=sorted_list_of_volumes_2, B=sorted_list_of_uncertaintites_2, C=sorted_list_of_relevances)

# ---- group: Vol x Relev
sorted_list_of_relevances_2 = Data(cull_20)
sorted_list_of_volumes_3 = Data(cull_19)
multiplication_3 = Multiplication(A=sorted_list_of_volumes_3, B=sorted_list_of_relevances_2)

# ----
sorted_list_of_volumes_4 = Data(sorted_list_of_volumes)

# ---- group: AUV
ma = MassAddition(Input=flatten(multiplication))  # -> Result, PartialResults
ma_2 = MassAddition(Input=flatten(sorted_list_of_volumes_4))  # -> Result, PartialResults
division = Division(A=ma.Result, B=ma_2.Result)

# ---- group: AUVR
ma_3 = MassAddition(Input=flatten(multiplication_2))  # -> Result, PartialResults
ma_4 = MassAddition(Input=flatten(multiplication_3))  # -> Result, PartialResults
division_2 = Division(A=ma_3.Result, B=ma_4.Result)

# ---- group: write result
expression_2 = Expression(x=division, Expression="Round(x,2)")
join = TextJoin(Text=[expression_2, "%"], Join=" ")
merge = Merge(Data1="AU_V = ", Data2=join)
text_join = TextJoin(Text=merge)
panel_10 = Panel(text_join)
context_print = ContextPrint(Text=panel_10)

expression_3 = Expression(x=division_2, Expression="Round(x,2)")
join_2 = TextJoin(Text=[expression_3, "%"], Join=" ")
merge_2 = Merge(Data1="AU_VR = ", Data2=join_2)
text_join_2 = TextJoin(Text=merge_2)
panel_11 = Panel(text_join_2)
context_print_2 = ContextPrint(Text=panel_11)

# ----
# 4) RESULTS
panel_12 = Panel(panel_10)
# Optionally this algorithm can run without even
# opening Grasshopper by clicking on the Grasshopper
# Player icon (or by typing GrasshopperPlayer) in Rhino,
# loading this GH file, and following the instruction in the
# command bar.
panel_13 = Panel(panel_11)
