# Grasshopper definition EXPORT_MULTI_OBJ.gh (Grasshopper 1.0.8)
# plug-ins: CORE.Toolbox.Grasshopper, Human

# ----
# Export OBJ
# When the button
# is pushed a folder
# with this name will
# be created on desktop
push_to_create_the_folder_and_export = Button()
name_of_the_folder = Panel("Grasshopper_Export")

# ----
# -Create a new layer in Rhino
# named "Export OBJ"
# -Drag all the layers you want to export
# inside the layer "Export OBJ"
# Layer names that
# will be exported
layer_names_to_export = Panel("Export")
update_layers = Button()

python_3_script = Python3Script(folder_name=name_of_the_folder, create=push_to_create_the_folder_and_export)  # -> result, folder_path; inputs folder_name: String, create: Boolean
# ---------- python_3_script: Python ----------
"""  
Inputs:  
    folder_name: str   # Name of the folder to create  
    create: bool       # Button (True when clicked)  
Outputs:  
    result: str        # Message about success or error  
    folder_path: str   # Full path of the folder  
"""

import os
import scriptcontext as sc

# Define keys for sticky storage
RESULT_KEY = "gh_folder_result"
PATH_KEY = "gh_folder_path"

# If button is pressed and folder name is valid
if create and folder_name:
    try:
        # Get desktop path of current user
        desktop = os.path.join(os.path.expanduser("~"), "Desktop")
        folder_path = os.path.join(desktop, folder_name)

        # Create folder if it doesn't exist
        if not os.path.exists(folder_path):
            os.makedirs(folder_path)
            sc.sticky[RESULT_KEY] = f"Folder created: {folder_path}"
        else:
            sc.sticky[RESULT_KEY] = f"Folder already exists: {folder_path}"

        sc.sticky[PATH_KEY] = folder_path

    except Exception as e:
        sc.sticky[RESULT_KEY] = f"Error: {e}"
        sc.sticky[PATH_KEY] = None

# Always output whatever is stored
result = sc.sticky.get(RESULT_KEY, None)
folder_path = sc.sticky.get(PATH_KEY, None)
# ---------- end python_3_script ----------

# ---- group: read layers
layer_table = LayerTable(Update=update_layers, AutoUpdate=Toggle(False))  # -> Layers, FullLayerPaths, LayerColors, Linetypes, MaterialNames, Visible, PrintWidth, PrintColor
cull = CullPattern(List=layer_table.Layers, CullPattern=layer_table.Visible)
cull_2 = CullPattern(List=layer_table.FullLayerPaths, CullPattern=layer_table.Visible)

# ----
panel = Panel("""Brep
Extrusion
Mesh""")
text_join = TextJoin(Text=[layer_names_to_export, "*"])
match_text = MatchText(Text=cull_2, Pattern=text_join, Case=True)
cull_pattern = CullPattern(List=cull, CullPattern=match_text)
set_difference_s = SetDifferenceS(SetA=cull_pattern, SetB=layer_names_to_export)  # -> flatten(ExDifference)
dynamic_geometry_pipeline = DynamicGeometryPipeline(
    LayerFilter=set_difference_s,
    TypeFilter=panel,
    NameFilter="*",
    GroupByLayer=False,
    GroupByType=False,
    IncludeHidden=True,
    IncludeLocked=True,
    enableFullPath=False,
    listenToAttributes=True)  # -> simplify(GeometryOut)
brep = Brep(dynamic_geometry_pipeline)
data = Data(dynamic_geometry_pipeline)
clean_tree = CleanTree(RemoveNulls=True, RemoveInvalid=True, RemoveEmpty=False, Tree=brep)

# ----
# Export parameters
# Update mesh tessellation
aspect_ratio = Slider(5, range=0..20)
min_edge = Slider(0.5, range=0..1)
max_angle = Slider(10, range=1..20)
max_edge = Slider(1000, range=0..1000)
simple_planes = BooleanToggle(False)
dam = DataDam(DataA=clean_tree, BufferDelay=10000000, BufferMode=0)  # -> DataA, DataB

settings_custom = SettingsCustom(
    StitchSeams=True,
    SimplePlanes=simple_planes,
    Refine=True,
    MinCount=0,
    MaxCount=0,
    AspectRatio=aspect_ratio,
    MaxDistance=0,
    MaxAngle=max_angle,
    MinEdge=min_edge,
    MaxEdge=max_edge)
null_item = NullItem(Item=brep)  # -> NullFlags, InvalidFlags, Description
cull_pattern_2 = CullPattern(List=data, CullPattern=null_item.NullFlags)
# Data Dam
data_2 = Data(dam.DataA)
mesh_brep = MeshBrep(Brep=data_2, Settings=settings_custom)
mesh = Mesh(cull_pattern_2)
text = Text(simplify(graft(set_difference_s)))
merge = Merge(Data1=mesh_brep, Data2=mesh)
tstat = TreeStatistics(Tree=text)  # -> Paths, Length, Count
tstat_2 = TreeStatistics(Tree=merge)  # -> Paths, Length, Count
compare = PathCompare(Path=tstat.Paths, Mask=tstat_2.Paths)
cull_3 = CullPattern(List=tstat.Paths, CullPattern=compare)
branch = TreeBranch(Tree=text, Path=cull_3, MaintainPaths=True)
guid = Guid()
construct_attributes = ConstructAttributes()

# ----
# Preview edges
number_slider = Slider(0.01, range=0.01..12)
medges = MeshEdges(Mesh=merge)  # -> NakedEdges, InteriorEdges, NonManifoldEdges
previewlw = CustomPreviewLineweights(
    Geometry=[medges.NakedEdges, medges.InteriorEdges],
    Shader=ColourSwatch(SwatchColor=RGB(0, 0, 0)),
    Thickness=number_slider,
    Absolute=True)

# ----
# Export OBJ
export_obj = ExportOBJ(Geometry=merge, DirectoryPath=python_3_script.folder_path, FileName=branch, Save=push_to_create_the_folder_and_export)
