# Grasshopper definition MODEL_PROOF.gh (Grasshopper 1.0.8)
# Copyright: 2017
# plug-ins: Bifocals

# ----
# Relay
# Colour Swatch
# Guid
# Python 3 Script
# Data
# C# Script
# Data Dam
# Brep
# Custom Preview
# Digit Scroller
# STEP 0:
# -LOAD YOUR BREPS HERE
# (Load semantically segmented models.
# Granular models with simple mathematics
# are faster to compute)
# Load all Rhino geometry here,
# (use Ctrl+A on Rhino viewport
# to load eventual out of view
# geometry, then right click on
# the Grasshopper node to
# "set multiple Breps")
# Load NURBS Geometry
right_click_this_node_and_click_set_mult = Brep()  # "Right click this node and click \"Set Multiple Breps\""

clean_tree = CleanTree(RemoveNulls=True, RemoveInvalid=False, RemoveEmpty=False, Tree=right_click_this_node_and_click_set_mult)
# FOLLOW THE STEPS IN THIS ORDER
# STEP 1:
# -SELECT INVALID OBJECTS
# (erase or remodel them manually)
data = Data(clean_tree)

# ---- group: Click play to load input geometry
uploaded_objects = Brep(data)

# ----
data_2 = Data(uploaded_objects)

# ----
# Find invalid objects via
# "validity_results.append"
# Python script
python_3_script = Python3Script(breps=data_2)  # -> out, invalid; inputs breps: list of Brep
# ---------- python_3_script: Python ----------
import Rhino.Geometry as rg

# Definizione di una variabile globale per memorizzare i risultati di validità
validity_results = []

# Inputs
breps = breps  # Lista di Breps da controllare

# Ciclo per verificare la validità di ogni Brep
for brep in breps:
    if isinstance(brep, rg.Brep):
        # Verifica se la Brep è valida
        is_valid = brep.IsValid
        if is_valid:
            validity_results.append(False)  # Brep è valida
        else:
            validity_results.append(True)  # Brep non è valida
    else:
        # Se l'oggetto non è una Brep, considera il risultato come non valido
        validity_results.append(True)

# Output
invalid = validity_results  # Output della lista di booleani
# ---------- end python_3_script ----------

# ----
# Cull invalid objects
# from input list
cull_pattern = CullPattern(List=data_2, CullPattern=invert(python_3_script.invalid))
updated_list_of_objects = Data(cull_pattern)

data_3 = Data(updated_list_of_objects)
# STEP 2:
# -SELECT OPEN OBJECTS
# (erase or cap them manually)
data_4 = Data(data_3)

# ---- group: input geometry
updated_list_of_objects_2 = Brep(data_4)

# ----
# Find naked edges
brep_edges = BrepEdges(Brep=updated_list_of_objects_2)  # -> Naked, Interior, NonManifold
list_length = ListLength(List=brep_edges.Naked)  # -> flatten(Length)
larger_than = LargerThan(FirstNumber=list_length, SecondNumber="0")  # -> LargerThan, OrEqualTo

# ----
# Cull open objects
# from input list
cull_pattern_2 = CullPattern(List=updated_list_of_objects_2, CullPattern=invert(larger_than.LargerThan))
updated_list_of_objects_3 = Data(cull_pattern_2)

data_5 = Data(updated_list_of_objects_3)
data_6 = Data(data_5)

# ---- group: input geometry
updated_list_of_objects_4 = Brep(data_6)

# ----
# Select duplicate Breps
# (brep.IsDuplicate)
python_3_script_2 = Python3Script(breps=updated_list_of_objects_4)  # -> out, unique_breps_list, duplicate_breps_list, duplicate_indices_list; inputs breps: list of GeometryBase
# ---------- python_3_script_2: Python ----------
import Rhino.Geometry as rg
import scriptcontext as sc

# Lista delle polisuperfici in input
input_breps = breps  # Assumendo 'breps' come l'input delle polisuperfici in Grasshopper

# Dizionario per memorizzare le polisuperfici uniche
unique_breps = {}
duplicate_breps = {}

# Tolleranza per il confronto di geometrie (può essere regolato in base alle esigenze)
tolerance = sc.doc.ModelAbsoluteTolerance

for index, brep in enumerate(input_breps):
    is_duplicate = False
    for key, unique_brep in unique_breps.items():
        # Confronto le polisuperfici basato sulla geometria e sulla tolleranza
        if brep.IsDuplicate(unique_brep, tolerance):
            is_duplicate = True
            # Aggiungi l'oggetto duplicato al dizionario e memorizza l'indice dell'oggetto unico
            duplicate_breps[brep] = index
            break
    
    if not is_duplicate:
        unique_breps[brep] = brep

# Estrai solo le polisuperfici uniche dal dizionario
unique_breps_list = list(unique_breps.values())
duplicate_breps_list = list(duplicate_breps.keys())
duplicate_indices_list = list(duplicate_breps.values())  # Lista degli indici degli oggetti duplicati

# Ora unique_breps_list contiene le polisuperfici uniche
# duplicate_breps_list contiene le polisuperfici duplicate
# duplicate_indices_list contiene gli indici degli oggetti duplicati

# Output desiderato: unique_breps_list, duplicate_breps_list, duplicate_indices_list
# ---------- end python_3_script_2 ----------

# ----
# Cull dups from
# input list
cull_index = CullIndex(List=updated_list_of_objects_4, Indices=python_3_script_2.duplicate_indices_list, Wrap=True)
updated_list = Data(cull_index)

data_7 = Data(updated_list)
data_8 = Data(data_7)

# ---- group: input geometry
updated_list_of_objects_5 = Brep(data_8)

# ----
deconstruct_brep = DeconstructBrep(Brep=updated_list_of_objects_5)  # -> Faces, Edges, Vertices
average = Average(Input=deconstruct_brep.Vertices)  # -> flatten(ArithmeticMean)
distance = Distance(PointA=average, PointB="0,0,0")

# ----
# Find wrong geometry
# Increase the volume threshold
# to remove false positives
volume_threshold = DigitScroller(Scroller_Digits=12, Scroller_Prefix="Volume threshold", Scroller_Radix=6, Scroller_Value=0.001)
# Chose the threshold distance
# to be slightly bigger than the
# size of the 3D model
# Click play to calculate
# precise volume intersections.
# Switch view in transparent mode
# to see the intersecting volumes.
# (it can take up to 15 minutes, for
# better performance input small
# groups of Objects)
threshold_distance_cm = DigitScroller(Scroller_Digits=12, Scroller_Prefix="Threshold distance (cm)", Scroller_Radix=9, Scroller_Value=20000)
click_to_select_invalid_objcets = Button()
click_to_select_objects_far_from_zero = Button()
click_to_select_duplicate_objects = Button()
click_to_select_intersecting_objects = Button()
click_to_select_open_objects = Button()

data_9 = Data(click_to_select_invalid_objcets)
data_10 = Data(click_to_select_open_objects)
data_11 = Data(click_to_select_duplicate_objects)
threshold_distance = Data(threshold_distance_cm)
data_12 = Data(click_to_select_objects_far_from_zero)
data_13 = Data(click_to_select_intersecting_objects)
threshold_distance_2 = Data(threshold_distance)

# ---- group: boolean toggle to select geometry
boolean_toggle = Data(data_9)

# STEP 5:
# -ADD GROUPS OF CLOSED BREPS
# -SELECT OBJECTS THAT COLLIDE AND INTERSECT
# -ERASE OR CORRECT THEM
# (input small groups of objects to reduce computation times)
boolean_toggle_2 = Data(data_12)

boolean_toggle_3 = Data(data_13)

# STEP 3:
# -SELECT DUPLICATE OBJECTS
# (erase them manually)
boolean_toggle_4 = Data(data_10)

# STEP 4:
# -FIND OBJECTS FAR FROM ZERO
# (erase them manually)
boolean_toggle_5 = Data(data_11)

# ----
larger_than_2 = LargerThan(FirstNumber=distance, SecondNumber=threshold_distance_2)  # -> LargerThan, OrEqualTo

# ----
# Select open Breps
# in Rhino viewport
guid = Guid(updated_list_of_objects_2)
cull_pattern_3 = CullPattern(List=guid, CullPattern=larger_than.LargerThan)
python_3_script_3 = Python3Script(x=cull_pattern_3, y=boolean_toggle_4)  # -> out, a; inputs x: list of String, y: Boolean
# ---------- python_3_script_3: Python ----------
import Rhino
import scriptcontext as sc
import System

# Assicurati di operare sul documento attivo
sc.doc = Rhino.RhinoDoc.ActiveDoc

def select_objects_by_id(object_ids):
    # Deseleziona tutti gli oggetti nel documento
    deselect_all_objects()
    
    # Lista per tenere traccia degli oggetti trovati e selezionati
    selected_ids = []
    
    print("Selection activated.")
    # Itera su ciascun ID
    for obj_id in object_ids:
        try:
            # Converte la stringa in GUID
            guid = System.Guid(obj_id)
            
            # Trova l'oggetto in base al GUID
            obj = sc.doc.Objects.Find(guid)
            
            if obj:
                # Seleziona l'oggetto
                obj.Select(True)
                selected_ids.append(obj_id)
                print(f"Selected object ID: {obj_id}")
            else:
                print(f"Object ID {obj_id} not found in the document.")
        except Exception as e:
            print(f"Error with ID {obj_id}: {e}")
    
    # Aggiorna la vista per riflettere le selezioni
    sc.doc.Views.Redraw()
    
    return selected_ids

def deselect_all_objects():
    # Utilizza RhinoCommon per deselezionare tutti gli oggetti
    for obj in sc.doc.Objects:
        if obj.IsSelected(False) > 0:
            obj.Select(False)

# Inputs
object_ids = x  # Assumendo che x sia già una lista di ID
button_pressed = y  # Booleano generato dal pulsante

# Verifica che il documento attivo sia corretto
print("Active Document:", sc.doc)

# Se il pulsante è premuto, esegui la selezione
selected_objects = []
if button_pressed:
    selected_objects = select_objects_by_id(object_ids)

# Output
a = selected_objects
# ---------- end python_3_script_3 ----------

# ----
# Cull far objects
# from input list
cull_pattern_4 = CullPattern(List=updated_list_of_objects_5, CullPattern=invert(larger_than_2.LargerThan))
updated_list_2 = Data(cull_pattern_4)

# ----
# Select ivalid objects
# in Rhino viewport
guid_2 = Guid(data_2)
cull_pattern_5 = CullPattern(List=guid_2, CullPattern=python_3_script.invalid)
python_3_script_4 = Python3Script(x=cull_pattern_5, y=boolean_toggle)  # -> out, a; inputs x: list of String, y: Boolean; same code as python_3_script_3

# ----
# Select duplicates
# in Rhino viewport
guid_3 = Guid(updated_list_of_objects_5)
cull_pattern_6 = CullPattern(List=guid_3, CullPattern=larger_than_2.LargerThan)
python_3_script_5 = Python3Script(x=cull_pattern_6, y=boolean_toggle_2)  # -> out, a; inputs x: list of String, y: Boolean; same code as python_3_script_3

# ----
# Select duplicates
# in Rhino viewport
guid_4 = Guid(updated_list_of_objects_4)
list_item = ListItem(List=guid_4, Index=python_3_script_2.duplicate_indices_list, Wrap=True)
python_3_script_6 = Python3Script(x=list_item, y=boolean_toggle_5)  # -> out, a; inputs x: list of String, y: Boolean; same code as python_3_script_3

# ----
# Text alert if errors
# are detected
panel = Panel("Open Objects Detected")
list_length_2 = ListLength(List=cull_pattern_3)
concatenate = Concatenate(FragmentD="[", FragmentA=list_length_2, FragmentE="]", FragmentB=" ", FragmentC=panel)
panel_2 = Panel(concatenate)

# ----
# Text alert if errors
# are detected
panel_3 = Panel("Far Objects Detected")
list_length_3 = ListLength(List=cull_pattern_6)
concatenate_2 = Concatenate(FragmentE="[", FragmentA=list_length_3, FragmentD="]", FragmentB=" ", FragmentC=panel_3)
panel_4 = Panel(concatenate_2)

# ----
# Text alert if errors
# are detected
panel_5 = Panel("Invalid Objects Detected")
list_length_4 = ListLength(List=cull_pattern_5)
concatenate_3 = Concatenate(FragmentD="[", FragmentA=list_length_4, FragmentE="]", FragmentB=" ", FragmentC=panel_5)
panel_6 = Panel(concatenate_3)

# ----
# Text alert if errors
# are detected
panel_7 = Panel("Duplicate Objects Detected")
list_length_5 = ListLength(List=list_item)
concatenate_4 = Concatenate(FragmentE="[", FragmentA=list_length_5, FragmentD="]", FragmentB=" ", FragmentC=panel_7)
panel_8 = Panel(concatenate_4)

data_14 = Data(updated_list_2)
data_15 = Data(data_14)

# ---- group: input geometry
updated_list_of_objects_6 = Brep(data_15)

# ----
panel_10 = Panel(panel_4)

# ----
# Change intersection color
colour_swatch = ColourSwatch(SwatchColor=RGB(255, 0, 0))

# ---- group: Data Dam (moved to input panel)
data_dam = Data(updated_list_of_objects_6)

# ----
data_dam_2 = DataDam(DataA=data_dam, BufferDelay=10000000, BufferMode=0)

# ---- group: Data Dam (moved to input panel) (continued)
data_dam_3 = Data(data_dam_2)

# ----
# Filter Breps by intersecting
# Bounding Boxes
# (rg.BoundingBox.Intersection)
python_3_script_7 = Python3Script(breps=data_dam_3)  # -> collisions; inputs breps: list of Brep
# ---------- python_3_script_7: Python ----------
"""
Script Python per Grasshopper (GhPython)
Input:
    breps: list di Brep (chiusi)
Output:
    collisions: DataTree con gli indici dei Brep che hanno bounding box in collisione (no solo contatto)
"""

import Rhino.Geometry as rg
from Grasshopper import DataTree
from Grasshopper.Kernel.Data import GH_Path
import scriptcontext as sc

collisions = DataTree[int]()  # albero di indici

if breps:
    # Precalcola tutte le bounding box (tight)
    bboxes = [b.GetBoundingBox(True) for b in breps]

    tol = sc.doc.ModelAbsoluteTolerance

    for i, bb1 in enumerate(bboxes):
        path = GH_Path(i)  # <-- parte da 0

        for j, bb2 in enumerate(bboxes):
            if i == j:
                continue

            inters = rg.BoundingBox.Intersection(bb1, bb2)
            if inters and inters.IsValid:
                dx = inters.Max.X - inters.Min.X
                dy = inters.Max.Y - inters.Min.Y
                dz = inters.Max.Z - inters.Min.Z

                # escludi casi di solo contatto (nessuna dimensione > tol)
                if dx > tol and dy > tol and dz > tol:
                    collisions.Add(j, path)

        # garantisco che il ramo esista anche se vuoto
        if collisions.Branch(path) is None:
            collisions.EnsurePath(path)
# ---------- end python_3_script_7 ----------

# ----
# Boolean intersection
# (slow)
graft_tree = GraftTree(Tree=data_dam_3, IncludeEmptyLists=True, IncludeNullItems=True)  # -> simplify(Tree)
list_item_2 = ListItem(List=data_dam_3, Index=python_3_script_7, Wrap=True)  # -> simplify(Item)
solid_intersection = SolidIntersection(BrepsA=graft_tree, BrepsB=list_item_2)

# ----
# Filter objects with atl
# east one intersection
clean_tree_2 = CleanTree(RemoveNulls=True, RemoveInvalid=True, RemoveEmpty=False, Tree=solid_intersection)

# ----
# Filter intersections smaller
# than threshold
volume = Volume(Geometry=clean_tree_2)  # -> Volume, Centroid
volume_threshold_2 = Data(volume_threshold)
larger_than_3 = LargerThan(FirstNumber=volume.Volume, SecondNumber=volume_threshold_2)  # -> LargerThan, OrEqualTo
cull_pattern_7 = CullPattern(List=clean_tree_2, CullPattern=larger_than_3.LargerThan)

custom_preview = CustomPreview(Geometry=cull_pattern_7, Material=colour_swatch)

# ----
# Filter lists of operators based on volume of result
integer = Integer(larger_than_3.LargerThan)
mass_addition = MassAddition(Input=integer)  # -> Result, PartialResults
larger_than_4 = LargerThan(FirstNumber=mass_addition.Result, SecondNumber="1")  # -> LargerThan, flatten(OrEqualTo)
guid_5 = Guid(simplify(graft(data_dam_3)))
param_viewer = ParamViewer(guid_5)
cull_pattern_8 = CullPattern(List=param_viewer, CullPattern=larger_than_4.OrEqualTo)
tree_branch = TreeBranch(Tree=guid_5, Path=cull_pattern_8, MaintainPaths=True)  # -> flatten(Branch)

# ----
# Select intersecting
# objets in Rhino
python_3_script_8 = Python3Script(x=tree_branch, y=boolean_toggle_3)  # -> out, a; inputs x: list of String, y: Boolean; same code as python_3_script_3

# ----
# Text alert if errors
# are detected
list_length_6 = ListLength(List=tree_branch)
concatenate_5 = Concatenate(FragmentD="[", FragmentA=list_length_6, FragmentE="]", FragmentB=" ", FragmentC="Intersecting Objects Detected")
panel_13 = Panel(concatenate_5)
