# Grasshopper definition Profing_Models_900.gh (Grasshopper 1.0.8)
# Copyright: 2017
# plug-ins: Bifocals

# ----
# Relay
# Colour Swatch
# Guid
# Python 3 Script
# Data
# C# Script
# Data Dam
# Brep
# Custom Preview
# STEP 0:
# -LOAD YOUR BREPS HERE
# (Load semantically segmented models.
# Granular models with simple mathematics
# are faster to compute)
# Load NURBS Geometry
right_click_this_node_and_click_set_mult = Brep([<brep referenced from the Rhino model> x23])  # "Right click this node and click \"Set Multiple Breps\""

# ----
# FOLLOW THE STEPS IN THIS ORDER
# STEP 1:
# -SELECT INVALID OBJECTS
# (erase or remodel them manually)
data = Data(right_click_this_node_and_click_set_mult)

# ---- group: Click play to load input geometry
uploaded_objects = Brep(data)

# ----
data_2 = Data(uploaded_objects)

# ----
# Find invalid objects via
# "validity_results.append"
# Python script
py3 = Python3Script(breps=data_2)  # -> out, invalid; inputs breps: list of Brep
# ---------- py3: Python ----------
import Rhino.Geometry as rg

# Definizione di una variabile globale per memorizzare i risultati di validità
validity_results = []

# Inputs
breps = breps  # Lista di Breps da controllare

# Ciclo per verificare la validità di ogni Brep
for brep in breps:
    if isinstance(brep, rg.Brep):
        # Verifica se la Brep è valida
        is_valid = brep.IsValid
        if is_valid:
            validity_results.append(False)  # Brep è valida
        else:
            validity_results.append(True)  # Brep non è valida
    else:
        # Se l'oggetto non è una Brep, considera il risultato come non valido
        validity_results.append(True)

# Output
invalid = validity_results  # Output della lista di booleani
# ---------- end py3 ----------

# ----
# Cull invalid objects
# from input list
cull = CullPattern(List=data_2, CullPattern=invert(py3.invalid))
updated_list_of_objects = Data(cull)

data_3 = Data(updated_list_of_objects)
data_4 = Data(data_3)

# ---- group: input geometry
# STEP 2:
# -SELECT OPEN OBJECTS
# (erase or cap them manually)
updated_list_of_objects_2 = Brep(data_4)

# ----
# Find naked edges
edges = BrepEdges(Brep=updated_list_of_objects_2)  # -> Naked, Interior, NonManifold
lng = ListLength(List=edges.Naked)  # -> flatten(Length)
larger = LargerThan(FirstNumber=lng, SecondNumber="0")  # -> LargerThan, OrEqualTo

# ----
# Cull open objects
# from input list
cull_2 = CullPattern(List=updated_list_of_objects_2, CullPattern=invert(larger.LargerThan))
updated_list_of_objects_3 = Data(cull_2)

data_5 = Data(updated_list_of_objects_3)
data_6 = Data(data_5)

# ---- group: input geometry
updated_list_of_objects_4 = Brep(data_6)

# ----
# Select duplicate Breps
# (brep.IsDuplicate)
python_3_script = Python3Script(breps=updated_list_of_objects_4)  # -> out, unique_breps_list, duplicate_breps_list, duplicate_indices_list; inputs breps: list of GeometryBase
# ---------- python_3_script: Python ----------
import Rhino.Geometry as rg
import scriptcontext as sc

# Lista delle polisuperfici in input
input_breps = breps  # Assumendo 'breps' come l'input delle polisuperfici in Grasshopper

# Dizionario per memorizzare le polisuperfici uniche
unique_breps = {}
duplicate_breps = {}

# Tolleranza per il confronto di geometrie (può essere regolato in base alle esigenze)
tolerance = sc.doc.ModelAbsoluteTolerance

for index, brep in enumerate(input_breps):
    is_duplicate = False
    for key, unique_brep in unique_breps.items():
        # Confronto le polisuperfici basato sulla geometria e sulla tolleranza
        if brep.IsDuplicate(unique_brep, tolerance):
            is_duplicate = True
            # Aggiungi l'oggetto duplicato al dizionario e memorizza l'indice dell'oggetto unico
            duplicate_breps[brep] = index
            break
    
    if not is_duplicate:
        unique_breps[brep] = brep

# Estrai solo le polisuperfici uniche dal dizionario
unique_breps_list = list(unique_breps.values())
duplicate_breps_list = list(duplicate_breps.keys())
duplicate_indices_list = list(duplicate_breps.values())  # Lista degli indici degli oggetti duplicati

# Ora unique_breps_list contiene le polisuperfici uniche
# duplicate_breps_list contiene le polisuperfici duplicate
# duplicate_indices_list contiene gli indici degli oggetti duplicati

# Output desiderato: unique_breps_list, duplicate_breps_list, duplicate_indices_list
# ---------- end python_3_script ----------

# ----
# Cull dups from
# input list
cull_i = CullIndex(List=updated_list_of_objects_4, Indices=python_3_script.duplicate_indices_list, Wrap=True)
updated_list = Data(cull_i)

data_7 = Data(updated_list)
data_8 = Data(data_7)

# ---- group: input geometry
updated_list_of_objects_5 = Brep(data_8)

# ----
# Find wrong geometry
click_to_select_invalid_objcets = Button()
# Click play to calculate
# precise volume intersections
# (input small groups of solids
# for better performances)
click_to_select_open_objects = Button()
click_to_select_duplicate_objects = Button()
click_to_select_intersecting_objects = Button()

data_9 = Data(click_to_select_invalid_objcets)
data_10 = Data(click_to_select_open_objects)
data_11 = Data(click_to_select_duplicate_objects)
data_12 = Data(click_to_select_intersecting_objects)

# ---- group: boolean toggle to select geometry
boolean_toggle = Data(data_9)

# STEP 3:
# -SELECT DUPLICATE OBJECTS
# (erase them manually)
boolean_toggle_2 = Data(data_10)

# STEP 4:
# -ADD GROUPS OF CLOSED BREPS
# -SELECT OBJECTS THAT COLLIDE AND INTERSECT
# -ERASE OR CORRECT THEM
# (input small groups of objects to reduce computation times)
boolean_toggle_3 = Data(data_11)

boolean_toggle_4 = Data(data_12)

# ----
# Select open Breps
# in Rhino viewport
id = Guid(updated_list_of_objects_2)
cull_3 = CullPattern(List=id, CullPattern=larger.LargerThan)
py3_2 = Python3Script(x=cull_3, y=boolean_toggle_2)  # -> out, a; inputs x: list of String, y: Boolean
# ---------- py3_2: Python ----------
import Rhino
import scriptcontext as sc
import System

# Assicurati di operare sul documento attivo
sc.doc = Rhino.RhinoDoc.ActiveDoc

def select_objects_by_id(object_ids):
    # Deseleziona tutti gli oggetti nel documento
    deselect_all_objects()
    
    # Lista per tenere traccia degli oggetti trovati e selezionati
    selected_ids = []
    
    print("Selection activated.")
    # Itera su ciascun ID
    for obj_id in object_ids:
        try:
            # Converte la stringa in GUID
            guid = System.Guid(obj_id)
            
            # Trova l'oggetto in base al GUID
            obj = sc.doc.Objects.Find(guid)
            
            if obj:
                # Seleziona l'oggetto
                obj.Select(True)
                selected_ids.append(obj_id)
                print(f"Selected object ID: {obj_id}")
            else:
                print(f"Object ID {obj_id} not found in the document.")
        except Exception as e:
            print(f"Error with ID {obj_id}: {e}")
    
    # Aggiorna la vista per riflettere le selezioni
    sc.doc.Views.Redraw()
    
    return selected_ids

def deselect_all_objects():
    # Utilizza RhinoCommon per deselezionare tutti gli oggetti
    for obj in sc.doc.Objects:
        if obj.IsSelected(False) > 0:
            obj.Select(False)

# Inputs
object_ids = x  # Assumendo che x sia già una lista di ID
button_pressed = y  # Booleano generato dal pulsante

# Verifica che il documento attivo sia corretto
print("Active Document:", sc.doc)

# Se il pulsante è premuto, esegui la selezione
selected_objects = []
if button_pressed:
    selected_objects = select_objects_by_id(object_ids)

# Output
a = selected_objects
# ---------- end py3_2 ----------

# ----
# Select ivalid objects
# in Rhino viewport
id_2 = Guid(data_2)
cull_4 = CullPattern(List=id_2, CullPattern=py3.invalid)
py3_3 = Python3Script(x=cull_4, y=boolean_toggle)  # -> out, a; inputs x: list of String, y: Boolean; same code as py3_2

# ----
# Select duplicates
# in Rhino viewport
id_3 = Guid(updated_list_of_objects_4)
item = ListItem(List=id_3, Index=python_3_script.duplicate_indices_list, Wrap=True)
py3_4 = Python3Script(x=item, y=boolean_toggle_3)  # -> out, a; inputs x: list of String, y: Boolean; same code as py3_2

# ----
# Text alert if errors
# are detected
panel = Panel("Open Objects Detected")
lng_2 = ListLength(List=cull_3)
concat = Concatenate(FragmentD="[", FragmentA=lng_2, FragmentE="]", FragmentB=" ", FragmentC=panel)
panel_2 = Panel(concat)

# ----
# Text alert if errors
# are detected
panel_3 = Panel("Invalid Objects Detected")
lng_3 = ListLength(List=cull_4)
concat_2 = Concatenate(FragmentD="[", FragmentA=lng_3, FragmentE="]", FragmentB=" ", FragmentC=panel_3)
panel_4 = Panel(concat_2)

# ----
# Text alert if errors
# are detected
panel_5 = Panel("Duplicate Objects Detected")
lng_4 = ListLength(List=item)
concat_3 = Concatenate(FragmentE="[", FragmentA=lng_4, FragmentD="]", FragmentB=" ", FragmentC=panel_5)
panel_6 = Panel(concat_3)

# ----
# Change intersection color
swatch = ColourSwatch(SwatchColor=RGB(255, 0, 0))

# ---- group: Data Dam (moved to input panel)
data_dam = Data(updated_list_of_objects_5)

# ----
dam = DataDam(DataA=data_dam, BufferDelay=10000000, BufferMode=0)

# ---- group: Data Dam (moved to input panel) (continued)
data_dam_2 = Data(dam)

# ----
# Filter Breps by intersecting
# Bounding Boxes
# (rg.BoundingBox.Intersection)
py3_5 = Python3Script(breps=data_dam_2)  # -> collisions; inputs breps: list of Brep
# ---------- py3_5: Python ----------
"""
Script Python per Grasshopper (GhPython)
Input:
    breps: list di Brep (chiusi)
Output:
    collisions: DataTree con gli indici dei Brep che hanno bounding box in collisione (no solo contatto)
"""

import Rhino.Geometry as rg
from Grasshopper import DataTree
from Grasshopper.Kernel.Data import GH_Path
import scriptcontext as sc

collisions = DataTree[int]()  # albero di indici

if breps:
    # Precalcola tutte le bounding box (tight)
    bboxes = [b.GetBoundingBox(True) for b in breps]

    tol = sc.doc.ModelAbsoluteTolerance

    for i, bb1 in enumerate(bboxes):
        path = GH_Path(i)  # <-- parte da 0

        for j, bb2 in enumerate(bboxes):
            if i == j:
                continue

            inters = rg.BoundingBox.Intersection(bb1, bb2)
            if inters and inters.IsValid:
                dx = inters.Max.X - inters.Min.X
                dy = inters.Max.Y - inters.Min.Y
                dz = inters.Max.Z - inters.Min.Z

                # escludi casi di solo contatto (nessuna dimensione > tol)
                if dx > tol and dy > tol and dz > tol:
                    collisions.Add(j, path)

        # garantisco che il ramo esista anche se vuoto
        if collisions.Branch(path) is None:
            collisions.EnsurePath(path)
# ---------- end py3_5 ----------

# ----
# Boolean intersection
# (slow)
graft = GraftTree(Tree=data_dam_2, IncludeEmptyLists=True, IncludeNullItems=True)  # -> simplify(Tree)
item_2 = ListItem(List=data_dam_2, Index=py3_5, Wrap=True)  # -> simplify(Item)
sint = SolidIntersection(BrepsA=graft, BrepsB=item_2)

preview = CustomPreview(Geometry=sint, Material=swatch)

# ----
# Filter objects with atl
# east one intersection
clean = CleanTree(RemoveNulls=True, RemoveInvalid=True, RemoveEmpty=False, Tree=sint)
lng_5 = ListLength(List=clean)
smaller = SmallerThan(FirstNumber=lng_5, SecondNumber="1")  # -> flatten(SmallerThan), OrEqualTo
not = GateNot(A=smaller.SmallerThan)

# ----
# Select intersecting
# objets in Rhino
id_4 = Guid(data_dam_2)
cull_5 = CullPattern(List=id_4, CullPattern=not)
py3_6 = Python3Script(x=cull_5, y=boolean_toggle_4)  # -> out, a; inputs x: list of String, y: Boolean; same code as py3_2

# ----
# Text alert if errors
# are detected
panel_10 = Panel("Intersecting Objects Detected")
lng_6 = ListLength(List=cull_5)
concat_4 = Concatenate(FragmentD="[", FragmentA=lng_6, FragmentE="]", FragmentB=" ", FragmentC=panel_10)
panel_11 = Panel(concat_4)
